# Grasshopper definition ToSimpleMesh.gh (Grasshopper 1.0.7)

crv = Curve()
end = EndPoints(Curve=crv)  # -> Start, End
pl = PlaneNormal(Origin=end.Start, ZAxis=crv)
polygon = Polygon(Plane=pl, Radius=0.3, Segments=6, FilletRadius=0)  # -> Polygon, Length
python = GhPythonScript(R=crv, S=polygon.Polygon)  # -> out, a; inputs R: list, S: list
# ---------- python: Python ----------
__author__ = "2016028"
__version__ = "2019.03.24"

import rhinoscriptsyntax as rs

#import ghpythonlib.parallel as p

from ghpythonlib.treehelpers import list_to_tree 

a=[]

input=[]
def ExtrudeMesh(Profile,Vector):


    Startpoints=rs.CurvePoints(Profile)[0:-1]


    
    Endpoints=rs.CopyObjects(Startpoints,translation=Vector)
    count=len(Startpoints)

    vertices=Startpoints+Endpoints
    face_vertices=[]
    for i in range(count):

        face_vertices.append([i,i+1,count+i,i+count-1])
        
    vertices=[rs.coerce3dpoint(i) for i in vertices]
    a=rs.AddMesh(vertices,face_vertices)
    
    return a
    
   
    
    
    




for i,j in zip(R,S):
    vector=rs.VectorCreate(rs.CurveEndPoint(i),rs.CurveStartPoint(i))
    
    
    new=[vector,j]
    input.append(new)



def Sweep(input):
    a.append(ExtrudeMesh(input[1],input[0]))

for i in input:
    a.append(ExtrudeMesh(i[1],i[0]))

    
a=list_to_tree (a)
# ---------- end python ----------
mesh = Mesh(python.a)
